# Grasshopper definition inclass.gh (Grasshopper 1.0.8)
# plug-ins: RhinoCodePluginGH

number_slider = Slider(20, range=0..20)
number_slider_2 = Slider(10, range=0..10)
number_slider_3 = Slider(1, range=0..1)
xy_plane = XYPlane(Origin=Point(0, 0, 0))
construct_point = ConstructPoint(XCoordinate=Slider(0.25, range=0..1), YCoordinate=0, ZCoordinate=0)
construct_point_2 = ConstructPoint(XCoordinate=0, YCoordinate=0, ZCoordinate=0)
construct_point_3 = ConstructPoint(XCoordinate=Slider(0.25, range=0..1), YCoordinate=Slider(0.25, range=0..1), ZCoordinate=Slider(0.25, range=0..1))
unit_z = UnitZ(Factor=Slider(1, range=0..1))
xz_plane = XZPlane(Origin=Point(0, 0, 0))
circle = Circle(Plane=xy_plane, Radius=number_slider_2)
xy_plane_2 = XYPlane(Origin=unit_z)
rectangle = Rectangle(Plane=xy_plane, XSize=number_slider, YSize=number_slider, Radius=0)  # -> Rectangle, Length
series = Series(Start=0, Step=number_slider_3, Count=10)
series_2 = Series(Start=0, Step=1, Count=10)
unit_y = UnitY(Factor=number_slider_2)
circle_3pt = Circle3Pt(PointA=construct_point_3, PointB=construct_point_2)  # -> Circle, Plane, Radius
rectangle_2 = Rectangle(Plane=PlaneXY(0, 0, 0), XSize=Slider(1, range=0..1), YSize=Slider(0.567, range=0..1), Radius=0)  # -> Rectangle, Length
rectangle_3 = Rectangle(Plane=xy_plane_2, XSize=Slider(0.646, range=0..1), YSize=Slider(0.715, range=0..1), Radius=0)  # -> Rectangle, Length
rectangle_4 = Rectangle(Plane=PlaneXY(0, 0, 0), XSize=Slider(0.624, range=0..1), YSize=Slider(0.735, range=0..1), Radius=0)  # -> Rectangle, Length
circle_2 = Circle(Plane=xz_plane, Radius=Slider(0.849, range=0..1))
unit_y_2 = UnitY(Factor=Slider(1, range=0..1))
move = Move(Geometry=circle, Motion=unit_y)  # -> Geometry, Transform
unit_z_2 = UnitZ(Factor=Slider(0.25, range=0..1))
unit_z_3 = UnitZ(Factor=series)
python_3_script = Python3Script(x=Slider(19, range=0..100), y=Slider(18, range=0..50))  # -> out, a; inputs y: Int32; unedited script template
extrude = Extrude(Base=circle_3pt.Plane)
move_2 = Move(Geometry=rectangle_4.Rectangle, Motion=unit_z_2)  # -> Geometry, Transform
panel = Panel(python_3_script.out)
extrude_2 = Extrude(Base=circle_2, Direction=unit_y_2)
point = Point(unit_z_3)
surface = Surface(rectangle.Rectangle)
surface_2 = Surface(move.Geometry)
xy_plane_3 = XYPlane(Origin=point)
geometry = Geometry([rectangle_3.Rectangle, rectangle_2.Rectangle, move_2.Geometry])
brep = Brep([surface, surface_2])
solid_difference = SolidDifference(BrepsA=surface, BrepsB=surface_2)
loft = Loft(Curves=geometry, Options={Adjust=False, Closed=False, LoftEnds=0, LoftSimp=0, LoftType=0, Rebuild=10, Refit=0.01})
solid_union = SolidUnion(Breps=brep)
brep_2 = Brep(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)
rectangle_5 = Rectangle(Plane=xy_plane_3, XSize=Domain(-1, 1), YSize=series_2, Radius=0)  # -> Rectangle, Length
geometry_2 = Geometry(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)
solid_intersection = SolidIntersection()
unit_z_4 = UnitZ(Factor=number_slider_3)
surface_3 = Surface(rectangle_5.Rectangle)
extrude_3 = Extrude(Base=surface_3, Direction=unit_z_4)
solid_union_2 = SolidUnion(Breps=extrude_3)
area = Area(Geometry=solid_union_2)  # -> Area, Centroid
bounding_box = BoundingBox(Content=solid_union_2, Plane=PlaneXY(0, 0, 0))  # -> Box, Box_2
deconstruct_box = DeconstructBox(Box=bounding_box.Box)  # -> Plane, X, Y, Z
deconstruct = Deconstruct(Point=area.Centroid)  # -> XComponent, YComponent, ZComponent
deconstruct_domain = DeconstructDomain(Domain=deconstruct_box.Z)  # -> Start, End
construct_point_4 = ConstructPoint(XCoordinate=deconstruct.XComponent, YCoordinate=deconstruct.YComponent, ZCoordinate=deconstruct_domain.End)
construct_point_5 = ConstructPoint(XCoordinate=deconstruct.XComponent, YCoordinate=deconstruct.YComponent, ZCoordinate=deconstruct_domain.Start)
line = Line(StartPoint=construct_point_5, EndPoint=construct_point_4)
construct_point_6 = ConstructPoint(XCoordinate=30, YCoordinate=10, ZCoordinate=20)
twist = Twist(Geometry=solid_union_2, Axis=line, Angle=1.570796327, Infinite=False, Rigid=False)
move_3 = Move(Geometry=twist, Motion=construct_point_6)  # -> Geometry, Transform
