# Grasshopper definition L2.gh (Grasshopper 1.0.8)
# plug-ins: Pancake

middle_rotation_angle = Slider(0, range=0..3.142)
middle_segments = Slider(3, range=3..12)
bottom_rotation_angle = Slider(0, range=0..3.142)
middle_move_x = Slider(0, range=-5..5)
twist_angle = Slider(1.919, range=0..3.142)
middle_height = Slider(2, range=0..10)
middle_move_y = Slider(0, range=-5..5)
height_of_object = Slider(6, range=0..10)
top_xz_rotation = Slider(-0.06, range=-3..3)
middle_radius = Slider(1, range=0..10)
top_segments = Slider(4, range=3..12)
distance_between_slices = Slider(0.5, range=0..5)
number_of_numbers = Slider(10, range=0..20)
bottom_segments = Slider(3, range=3..12)
bottom_radius = Slider(3, range=0..10)
top_radius = Slider(4, range=0..10)
number_slider = Slider(3, range=0..10)  # disabled
number_slider_2 = Slider(6, range=0..10)  # disabled
number_slider_3 = Slider(0.659, range=0..1)  # disabled
unit_z = UnitZ(Factor=height_of_object)
unit_z_2 = UnitZ(Factor=middle_height)
polygon = Polygon(Plane=PlaneXY(0, 0, 0), Radius=bottom_radius, Segments=bottom_segments, FilletRadius=0)  # -> Polygon, Length
unit_z_3 = UnitZ(Factor=number_slider)  # disabled
xz_plane = XZPlane(Origin=Point(0, 0, 0))
xy_plane = XYPlane(Origin=unit_z)
polygon_2 = Polygon(Plane=xy_plane, Radius=top_radius, Segments=top_segments, FilletRadius=0)  # -> Polygon, Length
xy_plane_2 = XYPlane(Origin=unit_z_2)
polygon_3 = Polygon(Plane=xy_plane_2, Radius=middle_radius, Segments=middle_segments, FilletRadius=0)  # -> Polygon, Length
vector_xyz = VectorXYZ(XComponent=middle_move_x, YComponent=middle_move_y, ZComponent=0)  # -> Vector, Length
rotate = Rotate(Geometry=polygon_3.Polygon, Angle=middle_rotation_angle, Plane=PlaneXY(0, 0, 0))  # -> Geometry, Transform
rotate_2 = Rotate(Geometry=polygon.Polygon, Angle=bottom_rotation_angle, Plane=PlaneXY(0, 0, 0))  # -> Geometry, Transform
xy_plane_3 = XYPlane(Origin=unit_z_3)  # disabled
polygon_4 = Polygon(Plane=xy_plane_3, Radius=3, Segments=number_slider_2, FilletRadius=0)  # -> Polygon, Length; disabled
rotate_3 = Rotate(Geometry=polygon_2.Polygon, Angle=top_xz_rotation, Plane=xz_plane)  # -> Geometry, Transform
explode = Explode(Curve=polygon_4.Polygon, Recursive=True)  # -> Segments, Vertices; disabled
move = Move(Geometry=rotate.Geometry, Motion=vector_xyz.Vector)  # -> Geometry, Transform
loft = Loft(
    Polygon=[rotate_2.Geometry, move.Geometry, rotate_3.Geometry],
    Options={Adjust=False, Closed=False, LoftEnds=0, LoftSimp=0, LoftType=0, Rebuild=10, Refit=0.01})
explode_2 = Explode(Curve=explode.Segments, Recursive=True)  # -> Segments, Vertices; disabled
cap_holes = CapHoles(Brep=loft)
average = Average(Input=explode.Vertices)  # disabled
cull_index = CullIndex(List=explode.Vertices, Indices=number_slider_2, Wrap=True)  # disabled
average_2 = Average(Input=explode_2.Vertices)  # disabled
solid_union = SolidUnion(Breps=cap_holes)
area = Area(Geometry=solid_union)  # -> Area, Centroid
line = Line(StartPoint=average, EndPoint=average_2)  # disabled
deconstruct = Deconstruct(Point=area.Centroid)  # -> XComponent, YComponent, ZComponent
evaluate_curve = EvaluateCurve(Curve=line, Parameter=number_slider_3)  # -> Point, Tangent, Angle; disabled
construct_point = ConstructPoint(XCoordinate=deconstruct.XComponent, YCoordinate=deconstruct.YComponent, ZCoordinate=height_of_object)
construct_point_2 = ConstructPoint(XCoordinate=deconstruct.XComponent, YCoordinate=deconstruct.YComponent, ZCoordinate=0)
xz_plane_2 = XZPlane(Origin=Point(0, 0, 0))
line_2 = Line(StartPoint=evaluate_curve.Point, EndPoint=explode_2.Vertices)  # disabled
line_3 = Line(StartPoint=construct_point_2, EndPoint=construct_point)
twist = Twist(Geometry=solid_union, Axis=line_3, Angle=twist_angle, Infinite=False, Rigid=False)
rotate_4 = Rotate(Geometry=twist, Angle=Slider(0, range=0..3.142), Plane=xz_plane_2)  # -> Geometry, Transform
join_curves = JoinCurves(Curves=flatten(line_2), Preserve=False)  # disabled
contour = Contour(Shape=rotate_4.Geometry, Point=Point(0, 0, 0), Direction=Vector(0, 0, 1), Distance=distance_between_slices)
surface = Surface(join_curves)  # disabled
surface_2 = Surface(contour)
area_2 = Area(Geometry=surface_2)  # -> Area, Centroid
deconstruct_2 = Deconstruct(Point=area_2.Centroid)  # -> XComponent, YComponent, ZComponent
xy_plane_4 = XYPlane(Origin=Point(0, 0, 0))
mesh = Mesh(twist)
series = Series(Start=0, Step=1, Count=number_of_numbers)  # -> graft(Series)
surface_3 = Surface(xy_plane_4)
construct_point_3 = ConstructPoint(XCoordinate=deconstruct_2.XComponent, YCoordinate=deconstruct_2.YComponent, ZCoordinate=deconstruct_2.ZComponent)
construct_point_4 = ConstructPoint(XCoordinate=1, YCoordinate=deconstruct_2.YComponent, ZCoordinate=deconstruct_2.ZComponent)
line_4 = Line(StartPoint=construct_point_3, EndPoint=construct_point_4)
text_on_surface = TextOnSurface(Text=series, Font="Sans Bold:no Italic:no", Height=0.2, Depth=0, BaseLine=line_4, BaseSurface=surface_3)
panel = Panel("/Users/alecwang/Documents/GitHub/CSCI/CSCI-4830/L2/export1.dxf")
true_only_button = TrueOnlyButton(LastSaveLocalization="neutral,N")
dxf_export_option = DXFExportOption(Scheme="Default", LastSaveLocalization="neutral,N")
geometry = Geometry(flatten([text_on_surface, surface_2]))
export_as = ExportAs(
    Geometry=geometry,
    FileLocation=panel,
    Overwrite=False,
    Options=dxf_export_option,
    Export=true_only_button,
    CompMode=False,
    LastSaveLocalization="neutral,N")  # -> OK, ExportCommand
