# Grasshopper definition M3.gh (Grasshopper 1.0.8)

unit_z = UnitZ(Factor=Slider(5, range=0..10))
unit_z_2 = UnitZ(Factor=Slider(10, range=0..10))
construct_point = ConstructPoint(XCoordinate=0, YCoordinate=Slider(10, range=0..10), ZCoordinate=0)
construct_point_2 = ConstructPoint(XCoordinate=Slider(-3, range=-10..10), YCoordinate=Slider(2, range=0..10), ZCoordinate=0)
construct_point_3 = ConstructPoint(XCoordinate=0, YCoordinate=0, ZCoordinate=0)
construct_point_4 = ConstructPoint(XCoordinate=Slider(7, range=0..10), YCoordinate=Slider(5, range=0..10), ZCoordinate=0)
construct_point_5 = ConstructPoint(XCoordinate=0, YCoordinate=Slider(10, range=0..10), ZCoordinate=0)
construct_point_6 = ConstructPoint(XCoordinate=Slider(4, range=0..10), YCoordinate=Slider(8, range=0..10), ZCoordinate=0)
construct_point_7 = ConstructPoint(XCoordinate=0, YCoordinate=0, ZCoordinate=0)
construct_point_8 = ConstructPoint(XCoordinate=0, YCoordinate=0, ZCoordinate=0)
construct_point_9 = ConstructPoint(XCoordinate=0, YCoordinate=Slider(10, range=0..10), ZCoordinate=0)
xy_plane = XYPlane(Origin=unit_z)
xy_plane_2 = XYPlane(Origin=Point(0, 0, 0))
xy_plane_3 = XYPlane(Origin=unit_z_2)
curve_on_surface = CurveOnSurface(Surface=xy_plane, UVCoordinates=[construct_point_3, construct_point_2, construct_point], Closed=False)  # -> Curve, Length, Domain
curve_on_surface_2 = CurveOnSurface(Surface=xy_plane_2, UVCoordinates=[construct_point_7, construct_point_4, construct_point_9], Closed=False)  # -> Curve, Length, Domain
curve_on_surface_3 = CurveOnSurface(Surface=xy_plane_3, UVCoordinates=[construct_point_8, construct_point_6, construct_point_5], Closed=False)  # -> Curve, Length, Domain
loft = Loft(
    Curves=[curve_on_surface_2.Curve, curve_on_surface.Curve, curve_on_surface_3.Curve],
    Options={Adjust=False, Closed=False, LoftEnds=0, LoftSimp=0, LoftType=0, Rebuild=10, Refit=0.01})
number_slider = Slider(0.5, range=0..10)
contour = Contour(Shape=loft, Point=Point(0, 0, 0), Direction=Vector(0, 0, 1), Distance=number_slider)
unit_z_3 = UnitZ(Factor=number_slider)
extrude = Extrude(Base=contour, Direction=unit_z_3)
unit_x = UnitX(Factor=Slider(1, range=0..10))
construct_point_10 = ConstructPoint(XCoordinate=Slider(2, range=0..10), YCoordinate=Slider(5, range=0..10), ZCoordinate=Slider(10.5, range=0..15))
xy_plane_4 = XYPlane(Origin=construct_point_10)
extrude_2 = Extrude(Base=extrude, Direction=unit_x)
ellipse = Ellipse(Plane=xy_plane_4, Radius1=Slider(5, range=0..20), Radius2=Slider(7, range=0..20))  # -> Ellipse, Focus1, Focus2
unit_z_4 = UnitZ(Factor=Slider(0.5, range=0..1))
extrude_3 = Extrude(Base=ellipse.Ellipse, Direction=unit_z_4)
cap_holes = CapHoles(Brep=extrude_3)
solid_union = SolidUnion(Breps=[extrude_2, cap_holes])
